# Dynamo graph Link Multiple DWGs.dyn (Dynamo 2.3.0.5885)
# packages: Data-Shapes 2019.2.42

# group: Name of the Form
code_block = CodeBlock { "Link multiple DWGs"; }

# group: Path to Logo Image
file_path = Filename("\\LND-SRV-DOM\Users\vkuzev\My Documents\My Pictures\grimshaw-200x200.png")

# group: DropDowns Names
code_block_2 = CodeBlock { "Colors"; }
code_block_3 = CodeBlock { "Positioning"; }
code_block_4 = CodeBlock { "Import units"; }

# group: Get Import Options Variations
python_script = Python()
# ---------- python_script.python (35 lines) ----------
#Viktor Kuzev 2019 viktor.kuzev@gmail.com
import clr
clr.AddReference('ProtoGeometry')
from Autodesk.DesignScript.Geometry import *

# Import DocumentManager and TransactionManager
clr.AddReference("RevitServices")
import RevitServices
from RevitServices.Persistence import DocumentManager
from RevitServices.Transactions import TransactionManager

doc = DocumentManager.Instance.CurrentDBDocument
uiapp = DocumentManager.Instance.CurrentUIApplication
app = uiapp.Application

# Import RevitAPI
clr.AddReference("RevitAPI")
import Autodesk
from Autodesk.Revit.DB import *

#The inputs to this node will be stored as a list in the IN variables.
dataEnteringNode = IN

colormodelist = [ImportColorMode.Preserved, ImportColorMode.Inverted, ImportColorMode.BlackAndWhite]
colormodenames = ["Preserve", "Invert", "Black and White"]

placementlist = [ImportPlacement.Centered,ImportPlacement.Origin,ImportPlacement.Shared]
placementnames = ["Auto - Center to Center", "Auto - Origin to Origin", "Auto - by Shared Coordinates"]


unitlist = [ImportUnit.Default,ImportUnit.Foot,ImportUnit.Inch,ImportUnit.Meter,ImportUnit.Decimeter,ImportUnit.Centimeter,ImportUnit.Millimeter,ImportUnit.Custom]
unitnames = ["Auto-Detect", "feet", "inch", "meter","decimeter","centimeter","milimeter","Custom factor"]

#Assign your output to the OUT variable.
OUT = [colormodelist, colormodenames, placementlist, placementnames, unitlist, unitnames]
# ----------------------------------------
code_block_5 = CodeBlock(a=python_script) { a[0]; a[1]; "-----"; a[2]; a[3]; "------"; a[4]; a[5]; 0; }

# group: Make Import Options DropDowns
ui_dropdown_data = Custom[UI.DropDown Data](InputName=code_block_2, Keys=code_block_5.out1, Values=code_block_5.out0, DefaultValueIndex=code_block_5.out8)  # package Data-Shapes; Create data for DropDown input in UI.MultiInputForm ++ . Check out www.data-shapes.net for more infos.
ui_dropdown_data_2 = Custom[UI.DropDown Data](InputName=code_block_3, Keys=code_block_5.out4, Values=code_block_5.out3, DefaultValueIndex=code_block_5.out8)
ui_dropdown_data_3 = Custom[UI.DropDown Data](InputName=code_block_4, Keys=code_block_5.out7, Values=code_block_5.out6, DefaultValueIndex=code_block_5.out8)

# group: Import Options Checkboxes
code_block_6 = CodeBlock { "Correct lines that are slightly off axis"; }
ui_boolean_input = Custom[UI.Boolean input](SideText=code_block_6)  # package Data-Shapes; Creates a boolean input for UI.MultipleInputForm ++ . Check out www.data-shapes.net for more infos!
code_block_7 = CodeBlock { "Orient to View"; }
ui_boolean_input_2 = Custom[UI.Boolean input](SideText=code_block_7)
code_block_8 = CodeBlock { "Current view only"; }
ui_boolean_input_3 = Custom[UI.Boolean input](SideText=code_block_8)

# group: Import Directory Path
code_block_9 = CodeBlock { "DWGs in Directory"; }
ui_textbox_data = Custom[UI.TextBox Data](InputName=code_block_9)  # package Data-Shapes; Create Data for TextBox input in UI.MultipleInputForm ++ . Check out www.data-shapes.net for more informations

code_block_10 = CodeBlock { "Select link option"; ["Link all DWGs to the active view","Create a new drafting view for each DWG"]; [true,false]; 0; }
ui_dropdown_data_4 = Custom[UI.DropDown Data](InputName=code_block_10.out0, Keys=code_block_10.out1, Values=code_block_10.out2, DefaultValueIndex=code_block_10.out3)
boolean = BoolSelector(true)

# group: Create a Windows Form
list_create = List.Create(item0=ui_dropdown_data, item1=ui_dropdown_data_2, item2=ui_dropdown_data_3, item3=ui_boolean_input, item4=ui_boolean_input_2, item5=ui_boolean_input_3, item6=ui_textbox_data, item7=ui_dropdown_data_4)
code_block_11 = CodeBlock { "Cancel Operation"; }
ui_multipleinputform = Custom[UI.MultipleInputForm ++](Description_optional=code_block, Logo_optional=file_path, Inputs=list_create, Toggle=boolean, CancelButtonText_optional=code_block_11)  # package Data-Shapes; Create a form with multiple inputs. see www.data-shapes.net for tutorials and infos!

code_block_12 = CodeBlock(a=ui_multipleinputform.User_Inputs) { a[0]; a[1]; "-----"; a[2]; a[3]; "------"; a[4]; a[5]; a[6]; "------"; a[7]; }
directory_from_path = DirectoryObject(path=code_block_12.out8)
getDirectoryContents = FileSystem.GetDirectoryContents(directory=directory_from_path)

# group: Import The DWGs
python_script_2 = Python(IN[0]=getDirectoryContents.files, IN[1]=code_block_12.out0, IN[2]=code_block_12.out1, IN[3]=code_block_12.out3, IN[4]=code_block_12.out4, IN[5]=code_block_12.out6, IN[6]=code_block_12.out7, IN[7]=code_block_12.out10, IN[8]=code_block_12.out8)
# ---------- python_script_2.python (65 lines) ----------
#Viktor Kuzev 2019 viktor.kuzev@gmail.com
import clr
clr.AddReference('ProtoGeometry')
from Autodesk.DesignScript.Geometry import *

# Import DocumentManager and TransactionManager
clr.AddReference("RevitServices")
import RevitServices
from RevitServices.Persistence import DocumentManager
from RevitServices.Transactions import TransactionManager

doc = DocumentManager.Instance.CurrentDBDocument
uiapp = DocumentManager.Instance.CurrentUIApplication
app = uiapp.Application
clr.AddReference("RevitAPI")
import Autodesk
from Autodesk.Revit.DB import *

#The inputs to this node will be stored as a list in the IN variables.
dataEnteringNode = IN
files = IN[0]
view = doc.ActiveView



options = DWGImportOptions()
options.AutoCorrectAlmostVHLines = IN[4]
options.ColorMode = IN[1]
options.OrientToView = IN[5]
options.ThisViewOnly = IN[6]
options.VisibleLayersOnly = True
options.Unit = IN[3]
options.Placement = IN[2]
linkedElem = clr.Reference[ElementId]()
directoryStr = IN[8]+"\\"

names = []
if IN[7]:
	TransactionManager.Instance.EnsureInTransaction(doc)
	for filePath in files:
		try:
					
			doc.Link(filePath, options, view, linkedElem)
		
			
		except: pass
	TransactionManager.Instance.TransactionTaskDone()
else:
	viewTypeColl = FilteredElementCollector(doc).OfClass(ViewFamilyType)
	for i in viewTypeColl:
		if i.ViewFamily == ViewFamily.Drafting:
			viewType = i
		else:
			continue
			
	TransactionManager.Instance.EnsureInTransaction(doc)
	for filePath in files:
		view = ViewDrafting.Create(doc, viewType.Id)
		name = filePath.split(".dwg")[0]
		name = name.split(directoryStr)[1]
		names.append(name)
		doc.Link(filePath, options, view, linkedElem)
		view.Name = name
	TransactionManager.Instance.TransactionTaskDone()
OUT = files
# ----------------------------------------
